# Grasshopper definition gHowl_UDP_send+receive.ghx (Grasshopper 0.9.75)
# plug-ins: gHowl

port = Panel("7001")
udp_owl = UDPReceiver(Port=port, Pattern=0)  # -> Info, Data
panel = Panel(udp_owl.Data)
split = StringSplit(String=udp_owl.Data, Separators=";")
split_2 = SplitList(List=split, Index=2)  # -> ListA, ListB
# try either domain box or center box!
split_3 = SplitList(List=split_2.ListA, Index=1)  # -> ListA, ListB
split_1 = SplitList(List=split_2.ListB, Index=1)  # -> ListA, ListB
pt = ConstructPoint(XCoordinate=split_3.ListA, YCoordinate=split_3.ListB, ZCoordinate=0)
box = DomainBox(Base=pt, X=split_1.ListA, Y=split_1.ListB, Z=Domain(0, 2))
